# Grasshopper definition export_fixture.gh (Grasshopper 1.0.8)

S = Script()  # -> folder_path
# ---------- S: Python ----------
import sys
import os

ghComp = ghenv.Component
ghDoc = ghComp.OnPingDocument()

# the full path of the gh file
current_path = ghDoc.FilePath
# the current directory 
folder_path = os.path.abspath(os.path.join(current_path,"..","..","..","benchmarks","fixtures"))
# ---------- end S ----------
list = ValueList({"points", "curves"}, selected="points")
list_2 = ValueList({"points", "curves"}, selected="points")
read_json = BooleanToggle(True)
panel = Panel(S)
pop2d = Populate2D(
    Region={Plane=PlaneXY(0, 0, 0), Size=Domain2(u=0..20, v=0..10)},
    Count=Slider(1000, range=0..1000),
    Seed=Slider(5, range=0..10))
geo = Geometry(pop2d)
export_fixture = Python3Script(geo=geo, folder_path=panel, kind=list, file_name="Hello_fixture", save_json=Button())  # -> out; inputs geo: list, folder_path: String, kind: String, file_name: String, save_json: Boolean
# ---------- export_fixture: Python ----------
"""GH entry point: dump selected geometry to a benchmark fixture JSON.

Tooling, not part of the shipped library -- it touches no geomseq_core code,
only Rhino and json. Format and wanted datasets: docs/benchmark-fixtures.md

Inputs   save_json (bool)  write on True; leave False while wiring things up
         geo       (list)  Point3d when kind="points", Curve when kind="curves".
                           Set the GH input to List Access and NO type hint, so
                           one component can do both.
         kind      (str)   "points" or "curves" -- also the filename prefix the
                           harness globs for
         file_name (str)   label for this dataset, e.g. "real_lettering"
         folder_path  (str)   existing directory, e.g. ...\\benchmarks\\fixtures
Outputs  path, log

Do not name an input `dir`, `type`, `id` or any other builtin: an unconnected
input is simply not injected, so the name quietly resolves to the builtin
instead of raising NameError, and the failure surfaces somewhere confusing.

IMPORTANT: feed the geometry in its ORIGINAL, UNSORTED order. Exporting the
output of a previous sort makes the benchmark measure sorting an already-sorted
input -- greedy has nothing to do and 2-opt converges early, so the numbers come
out flattering and meaningless.

Only curve endpoints are recorded, which is all sort_curves itself reads.
"""

import json
import os
import re

KINDS = ("points", "curves")   # what benchmarks/python/cases.py knows how to load
PRECISION = 4                  # decimals; 1e-4 mm is well past any CAD tolerance
Z_TOLERANCE = 1e-9             # above this, Z is real data and dropping it matters


def slugify(text):
    """'Real Lettering v2' -> 'real_lettering_v2'; becomes the data column label."""
    return re.sub(r"[^a-z0-9]+", "_", (text or "").lower()).strip("_")


def point_row(p):
    return [round(p.X, PRECISION), round(p.Y, PRECISION)]


def curve_row(c):
    s, e = c.PointAtStart, c.PointAtEnd
    return [round(s.X, PRECISION), round(s.Y, PRECISION),
            round(e.X, PRECISION), round(e.Y, PRECISION)]


def z_values(kind, items):
    if kind == "points":
        return [abs(p.Z) for p in items]
    return [z for c in items for z in (abs(c.PointAtStart.Z), abs(c.PointAtEnd.Z))]


if __name__ == "__main__":
    log = []
    path = None

    label = slugify(file_name)                      # type: ignore # noqa: F821
    # A file_name of "points_foo" would otherwise become points_points_foo.json.
    for k in KINDS:
        if label.startswith(k + "_"):
            label = label[len(k) + 1:]

    if not save_json:                               # type: ignore # noqa: F821
        log.append("save_json is False -- nothing written.")
    elif not geo:                                   # type: ignore # noqa: F821
        log.append("no geometry supplied.")
    elif kind not in KINDS:                         # type: ignore # noqa: F821
        log.append("kind must be one of %s, got %r -- the harness globs on that "
                   "prefix and would not find the file." % (KINDS, kind))  # type: ignore # noqa: F821
    elif not label:
        log.append("file_name is empty (or slugifies to nothing).")
    elif not isinstance(folder_path, str) or not os.path.isdir(folder_path):  # type: ignore # noqa: F821
        log.append("folder_path is not an existing directory: %r" % (folder_path,))  # type: ignore # noqa: F821
    else:
        items = list(geo)                           # type: ignore # noqa: F821

        # The fixture format is 2D, but the core does receive Z. If the geometry
        # is off the world XY plane, dropping Z here would make the fixture
        # disagree with what Rhino actually feeds the DLL.
        try:
            max_z = max(z_values(kind, items))      # type: ignore # noqa: F821
        except AttributeError:
            max_z = 0.0
            log.append("WARNING: could not read Z -- does geo match kind=%r?"
                       % (kind,))                   # type: ignore # noqa: F821
        if max_z > Z_TOLERANCE:
            log.append("WARNING: max |Z| is %.6g -- Z is dropped by this format. "
                       "Project to XY first if that matters." % max_z)

        row = point_row if kind == "points" else curve_row   # type: ignore # noqa: F821
        data = [row(g) for g in items]

        payload = {
            "kind": kind,                           # type: ignore # noqa: F821
            "name": label,
            "source": "exported via benchmarks/gh/export_fixture.py",
            "units": "",   # fill in, or read Rhino.RhinoDoc.ActiveDoc.ModelUnitSystem
            "notes": "",   # describe the pattern -- a number is not interpretable without it
            "data": data,
        }

        path = os.path.join(folder_path, "%s_%s.json" % (kind, label))  # type: ignore # noqa: F821
        replaced = os.path.exists(path)

        # Metadata one key per line so the header is scannable; `data` stays on
        # a single line. Indenting it too costs 2.4x the size and 256k lines of
        # coordinates nobody reads (measured at 64k points).
        meta = {k: v for k, v in payload.items() if k != "data"}
        head = json.dumps(meta, indent=2, ensure_ascii=False)[:-2]  # drop "\n}"
        with open(path, "w", encoding="utf-8") as fh:
            fh.write(head + ',\n  "data": '
                     + json.dumps(data, separators=(",", ":")) + "\n}\n")

        log.append("%s %d %s -> %s"
                   % ("REPLACED" if replaced else "wrote", len(data), kind, path))  # type: ignore # noqa: F821
        log.append("fill in 'units' and 'notes'; check the input was unsorted.")

    log = "\n".join(log)
# ---------- end export_fixture ----------
read_fixture = Python3Script(rescan=Button(), kind_filter=list_2, select_ix=Slider(1, range=0..10), folder_path=panel)  # -> out, file_path, name, kind, info; inputs rescan: Boolean, kind_filter: String, select_ix: Int32, folder_path: String
# ---------- read_fixture: Python ----------
import json
import os
from pathlib import Path

import scriptcontext as sc
from Grasshopper.Kernel import GH_RuntimeMessageLevel as RML

KINDS = ("points", "curves")   # what benchmarks/python/cases.py knows how to load


def read_header(path):
    """Metadata only, without touching `data`.

    Fixtures are multi-MB and export_fixture.py writes the metadata one key per
    line with `data` on a single line, precisely so a listing can stop reading
    at that point. Parsing ten files in full just to show a table would cost
    ~9 MB of JSON for a header nobody needed loaded.
    """
    lines = []
    with open(path, encoding="utf-8") as fh:
        for line in fh:
            if line.lstrip().startswith('"data"'):
                break
            lines.append(line)
    text = "".join(lines).rstrip().rstrip(",")
    # The outer brace is on the line we stopped before. Cannot decide by looking
    # at the last character: a `params` block ends in `}` too, so the truncation
    # is closed either way. Try it closed, fall back to as-read for a file that
    # had no `data` line to stop at.
    try:
        return json.loads(text + "\n}")
    except ValueError:
        return json.loads(text)


def summarize(path):
    """(kind, name, note) for the table -- never raises; a bad file is listed
    with its error rather than dropped, since a missing row is harder to
    notice than a broken one."""
    stem = os.path.basename(path)
    try:
        doc = read_header(path)
    except (ValueError, OSError) as exc:
        return "?", stem, "UNREADABLE HEADER: %s" % exc

    kind = doc.get("kind") or "?"
    name = doc.get("name") or stem
    bits = []
    params = doc.get("params") or {}
    if params.get("n"):
        bits.append("n=%s" % params["n"])
    size = os.path.getsize(path)
    bits.append("%.1f MB" % (size / 1048576.0) if size >= 1048576
                else "%.0f KB" % (size / 1024.0))
    if doc.get("units"):
        bits.append(doc["units"])

    # The harness globs on the filename prefix but reads the `kind` field, so a
    # file whose name and field disagree loads as one thing and benchmarks as
    # another. Cheap to catch here; invisible in a timing table.
    if kind != stem.split("_", 1)[0]:
        bits.append("!! kind/filename mismatch")
    return kind, name, ", ".join(bits)


# Top-level, not guarded by __name__: a GH script component does not
# necessarily run as "__main__", and a guard that fails is silent -- no output,
# no error, which is the worst failure mode for a component.
file_path = None
name = None
kind = None
info = ""

folder = Path(folder_path) if folder_path else None  # type: ignore # noqa: F821

if folder is None or not folder.is_dir():
    ghenv.Component.AddRuntimeMessage(                # type: ignore # noqa: F821
        RML.Error, "Directory does not exist: %s" % folder)
    names = []
else:
    wanted = (kind_filter or "").strip().lower()      # type: ignore # noqa: F821
    if wanted and wanted not in KINDS:
        ghenv.Component.AddRuntimeMessage(            # type: ignore # noqa: F821
            RML.Warning,
            "kind_filter must be one of %s, got %r -- ignoring."
            % (KINDS, wanted))
        wanted = ""

    cache_key = "FIXTURE_LST_%s_%s" % (folder, wanted)
    if rescan or cache_key not in sc.sticky:          # type: ignore # noqa: F821
        pattern = "%s_*.json" % wanted if wanted else "*.json"
        names = sorted(p.name for p in folder.glob(pattern))
        sc.sticky[cache_key] = names
    else:
        names = sc.sticky[cache_key]

if not names:
    if folder is not None and folder.is_dir():
        ghenv.Component.AddRuntimeMessage(            # type: ignore # noqa: F821
            RML.Remark, "No fixture JSON found in %s" % folder)
    print("[empty]  (%s)" % folder)
else:
    rows = [(n,) + summarize(str(folder / n)) for n in names]
    width = max(len(r[0]) for r in rows)

    print("index | %-*s | kind   | dataset" % (width, "file"))
    print("-" * (width + 62))
    for i, (fname, fkind, fname_field, note) in enumerate(rows):
        print("{:>5} | {:<{w}} | {:<6} | {} -- {}".format(
            i, fname, fkind, fname_field, note, w=width))

    # Unconnected int inputs arrive as None, and None % int raises. Wrap with
    # modulo so any index -- negative or past the end -- still selects a row.
    pick = int(select_ix or 0) % len(rows)            # type: ignore # noqa: F821
    fname, kind, name, note = rows[pick]
    file_path = str(folder / fname)
    info = "[%d] %s\nkind: %s   dataset: %s\n%s" % (
        pick, fname, kind, name, note)
    print("\nselected [%d] %s" % (pick, fname))
# ---------- end read_fixture ----------
panel_2 = Panel(read_fixture.out)
read_fixture_2 = Python3Script(
    sample_n=Slider(3000, range=1..10000),
    seed=Slider(1, range=1..10),
    file_path=read_fixture.file_path,
    read_json=read_json)  # -> out, geo; inputs sample_n: Int32, seed: Int32, file_path: String, read_json: Boolean
# ---------- read_fixture_2: Python ----------
import json
import os
import random

import Rhino.Geometry as rg

KINDS = ("points", "curves")   # what benchmarks/python/cases.py knows how to load
DEFAULT_SEED = 1               # matches cases.sample


def sample(data, n, seed=DEFAULT_SEED):
    """`n` rows drawn from `data`, seeded, IN THE SOURCE'S OWN ORDER.

    Deliberately identical to sample() in benchmarks/python/cases.py -- if this
    drew differently, the geometry on screen would not be the geometry that was
    timed. Sampling rather than slicing keeps the distribution comparable across
    n; the indices are re-sorted because input order is itself under test, and
    random.sample hands its picks back shuffled.
    """
    if n >= len(data):
        return list(data)
    idx = sorted(random.Random(seed).sample(range(len(data)), n))
    return [data[i] for i in idx]


def point_geo(row):
    return rg.Point3d(row[0], row[1], 0.0)


def curve_geo(row):
    return rg.LineCurve(rg.Point3d(row[0], row[1], 0.0),
                        rg.Point3d(row[2], row[3], 0.0))


def describe(doc, path):
    """The provenance header, which is the point of filling it in on export."""
    lines = ["file: %s" % os.path.basename(path)]
    for key in ("kind", "name", "source", "units", "notes"):
        value = doc.get(key)
        if value:
            lines.append("%s: %s" % (key, value))
    params = doc.get("params")
    if params:
        lines.append("params: %s" % json.dumps(params, sort_keys=True))
    lines.append("rows in file: %d" % len(doc.get("data") or []))
    return "\n".join(lines)


# Top-level, not guarded by __name__: a GH script component does not
# necessarily run as "__main__", and a guard that fails is silent -- no
# output, no error, which is the worst failure mode for a component.
log = []
geo = []
kind = None
count = 0
info = ""

if not read_json:                               # type: ignore # noqa: F821
    log.append("read_json is False -- nothing loaded.")
elif not isinstance(file_path, str) or not os.path.isfile(file_path):  # type: ignore # noqa: F821
    log.append("file_path is not an existing file: %r" % (file_path,))  # type: ignore # noqa: F821
else:
    with open(file_path, encoding="utf-8") as fh:  # type: ignore # noqa: F821
        doc = json.load(fh)

    kind = doc.get("kind")
    data = doc.get("data") or []
    info = describe(doc, file_path)             # type: ignore # noqa: F821

    # The harness globs on the filename prefix but reads the `kind` field, so
    # a file whose name and field disagree loads as one thing and benchmarks
    # as another. Worth catching here rather than in a timing table.
    prefix = os.path.basename(file_path).split("_", 1)[0]  # type: ignore # noqa: F821
    if kind != prefix:
        log.append("WARNING: kind is %r but the filename says %r -- the "
                   "harness globs on the filename." % (kind, prefix))

    if kind not in KINDS:
        log.append("kind must be one of %s, got %r." % (KINDS, kind))
    elif not data:
        log.append("no rows in 'data'.")
    else:
        wanted = int(sample_n or 0)             # type: ignore # noqa: F821
        if wanted > len(data):
            log.append("sample_n %d exceeds the file's %d rows -- the "
                       "harness SKIPS a sweep size it cannot fill rather "
                       "than truncating, so loading all instead."
                       % (wanted, len(data)))
            wanted = 0
        rows = data if wanted <= 0 else sample(
            data, wanted, int(seed) if seed else DEFAULT_SEED)  # type: ignore # noqa: F821

        build = point_geo if kind == "points" else curve_geo
        try:
            geo = [build(r) for r in rows]
        except (TypeError, IndexError):
            geo = []
            log.append("row shape does not match kind=%r -- points want "
                       "[x, y] and curves [x0, y0, x1, y1]." % (kind,))

        count = len(geo)
        if count:
            log.append("loaded %d of %d %s%s"
                       % (count, len(data), kind,
                          "" if wanted <= 0 else " (seeded sample, source order)"))

log = "\n".join(log)
# ---------- end read_fixture_2 ----------
