# Grasshopper definition example.gh (Grasshopper 1.0.8)
# plug-ins: HorseshoeGH, Human, GeomSeq

srf = Surface([<surface referenced from the Rhino model> x7])
hs_medialaxis = Hs_MedialAxis(Brep=srf, Resolution=2, Smoothing=5)

number_slider = Slider(50, range=0..50000)
nameme = MyPythonEditer(n=number_slider)  # -> out, pts; inputs n: Int32
# ---------- nameme: Python ----------
import Rhino.Geometry as rg
import ghpythonlib.treehelpers as th
import random


pts = [rg.Point3d(random.uniform(0, 1000),
                  random.uniform(0, 1000),
                  0) for _ in range(n)]
# ---------- end nameme ----------
Y = UnitY(Factor=1)
multiplication = Multiplication(A=Y, B="5")
move = Move(Geometry=nameme.pts, Motion=multiplication)  # -> Geometry, Transform
random = Random(Range="0 to 360", Number=number_slider, Seed=2)
ln = Line(StartPoint=nameme.pts, EndPoint=move.Geometry)  # -> flatten(Line)
rotate = Rotate(Geometry=ln, Angle=degrees(random), Plane=nameme.pts)  # -> flatten(Geometry), Transform
path_mapper = PathMapper(rotate.Geometry, source="{x}", target="{0;x}")
crv = Curve(path_mapper)

number_slider_2 = Slider(5000, range=0..10000)
crv_2 = Curve([<curve referenced from the Rhino model> x2])
nameme_2 = MyPythonEditer(n=number_slider_2)  # -> out, pts; inputs n: Int32
# ---------- nameme_2: Python ----------
__author__ = "Yen-Fen Chan"
__version__ = "0.0.1"
__date__ = '2024.00.00'
__updated__ = '2024.00.00'

import Rhino.Geometry as rg
import ghpythonlib.treehelpers as th
import random


# pts = [rg.Point3d(random.uniform(0, 100),
#                   random.uniform(0, 100),
#                   0) for _ in range(n)]

pts = []
# 一個 50×50 的小區域擠 100 個點 (密度遠超 k=12)
for _ in range(int(n/2)):
    pts.append(rg.Point3d(random.uniform(0, 50),
                          random.uniform(0, 50), 0))
# 其他點正常散布
for _ in range(int(n/2)):
    pts.append(rg.Point3d(random.uniform(0, 1000),
                          random.uniform(0, 1000), 0))
# ---------- end nameme_2 ----------
nameme_3 = MyPythonEditer(n=Slider(5000, range=0..10000))  # -> out, pts; inputs n: Int32
# ---------- nameme_3: Python ----------
__author__ = "Yen-Fen Chan"
__version__ = "0.0.1"
__date__ = '2024.00.00'
__updated__ = '2024.00.00'

import Rhino.Geometry as rg
import ghpythonlib.treehelpers as th
import random

pts = []
# 三個分開的密集團，中心相距很遠
centers = [(0, 0), (500, 500), (0, 500)]
for cx, cy in centers:
    for _ in range(n // 3):
        pts.append(rg.Point3d(cx + random.uniform(-20, 20),
                              cy + random.uniform(-20, 20), 0))
# ---------- end nameme_3 ----------
nameme_4 = MyPythonEditer(n=number_slider)  # -> out, pts; inputs n: Int32
# ---------- nameme_4: Python ----------
__author__ = "Yen-Fen Chan"
__version__ = "0.0.1"
__date__ = '2024.00.00'
__updated__ = '2024.00.00'

import Rhino.Geometry as rg
import ghpythonlib.treehelpers as th
import random

pts = []
for _ in range(int(n/2)):
    pts.append(rg.Point3d(random.uniform(400, 600),
                          random.uniform(400, 600), 0))
# 其他點正常散布
for _ in range(int(n/2)):
    pts.append(rg.Point3d(random.uniform(0, 1000),
                          random.uniform(0, 1000), 0))
# ---------- end nameme_4 ----------
split = SplitList(List=nameme_2.pts, Index=expr("x/2", number_slider_2))  # -> ListA, ListB
partition = PartitionList(List=nameme_2.pts, Size=[3, 2])
entwine = Entwine(Branch00=nameme_2.pts, FlattenInputs=True)
partition_2 = PartitionList(List=nameme_2.pts, Size="1000")
toggle = BooleanToggle(True)
path_mapper_2 = PathMapper(partition_2, source="{0;0;x}", target="{0;x}")
number_slider_3 = Slider(1.4, range=0.1..5)
number_slider_4 = Slider(5, range=0.1..5)
number_slider_5 = Slider(50, range=0..100)
crv_3 = Curve([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])
pt = Point(path_mapper_2)
partition_3 = PartitionList(List=crv, Size="500")
path_mapper_3 = PathMapper(partition_3, source="{0;0;x}", target="{0;x}")
pline = PolyLine(Vertices=flatten(pt), Closed=False)
number_slider_6 = Slider(0, range=0..4)
number_slider_7 = Slider(2, range=0..10)  # disabled
end = EndPoints(Curve=crv)  # -> Start, End; disabled
pt_2 = Point(end.Start)  # disabled

nameme_5 = MyPythonEditer()  # -> out, chained; inputs crvs: list of Curve; disabled
# ---------- nameme_5: Python ----------
__author__ = "Yen-Fen Chan"
__version__ = "0.0.1"
__date__ = '2024.00.00'
__updated__ = '2024.00.00'

import Rhino.Geometry as rg
from typing import Iterable, List

def chain_curves(curves: Iterable[rg.Curve],
                 close_loop: bool = False
                ) -> List[rg.Curve]:
    """
    Chain a sequence of curves by inserting straight connectors between each
    curve’s end and the next curve’s start.

    :param curves: An iterable of Rhino.Geometry.Curve
    :param close_loop: If True, also connect the last curve back to the first.
    :return: A list of rg.Curve objects, alternating original curves and connector segments.
    """
    # Snapshot into a list so we can index and check length
    n = len(curves)
    if n == 0:
        return []
    if n == 1:
        return [crvs[0]]

    chained: List[rg.Curve] = []
    # chain between each pair
    for c1, c2 in zip(crvs[:-1], crvs[1:]):
        chained.append(c1)
        # create line connector and convert to NurbsCurve
        seg = rg.Line(c1.PointAtEnd, c2.PointAtStart)
        chained.append(seg.ToNurbsCurve())

    # append the last input curve
    chained.append(crvs[-1])

    # optionally close the loop
    if close_loop:
        seg = rg.Line(crvs[-1].PointAtEnd, crvs[0].PointAtStart)
        chained.append(seg.ToNurbsCurve())

    return chained


chained = chain_curves(crvs)
# ---------- end nameme_5 ----------

nameme_6 = MyPythonEditer(crvs=crv)  # -> out, chained; inputs crvs: list of Curve; disabled; same code as nameme_5
previewlw = CustomPreviewLineweights(
    Geometry=crv,
    Shader={diffuse=RGB(255, 105, 180), emission=RGB(76, 32, 54), shine=0.5, specular=RGB(255, 255, 255), transparency=0},
    Thickness=number_slider_7,
    Absolute=False)  # disabled

# ---- group: Length Comparison
len = Length(Curve=crv)  # disabled
len_2 = Length(Curve=nameme_6.chained)  # disabled
ma = MassAddition(Input=len)  # -> Result, PartialResults; disabled
ma_2 = MassAddition(Input=len_2)  # -> Result, PartialResults; disabled
total_trajectory_length = Panel(ma.Result)  # disabled
total_design_length = Panel(ma_2.Result)  # disabled
subtraction = Subtraction(A=total_design_length, B=total_trajectory_length)  # disabled
total_traveling_length = Panel(subtraction)  # disabled

len_3 = Length(Curve=crv)  # disabled
len_4 = Length(Curve=nameme_5.chained)  # disabled
ma_3 = MassAddition(Input=len_3)  # -> Result, PartialResults; disabled
ma_4 = MassAddition(Input=len_4)  # -> Result, PartialResults; disabled
total_trajectory_length_2 = Panel(ma_3.Result)  # disabled
total_design_length_2 = Panel(ma_4.Result)  # disabled
subtraction_2 = Subtraction(A=total_design_length_2, B=total_trajectory_length_2)  # disabled
total_traveling_length_2 = Panel(subtraction_2)  # disabled

# ----
pt_3 = ConstructPoint(XCoordinate=0, YCoordinate=0, ZCoordinate=0)  # disabled
qfdm = HS_QuickFDM(Plane=PlaneXY(0, 0, 0), Infill=crv, ProximityTolerance=0.01, CombineTolerance=0.01, StartPoint=pt_3)  # -> PathSequence, Indices, SegmentType, Flipped; disabled
panel = Panel("Travel")  # disabled
panel_2 = Panel("Infill")  # disabled
panel_3 = Panel(qfdm.SegmentType)  # disabled
expression = Expression(x=qfdm.SegmentType, y=panel, Expression="x=y")  # disabled
expression_2 = Expression(x=qfdm.SegmentType, y=panel_2, Expression="x=y")  # disabled
cull = CullPattern(List=qfdm.PathSequence, CullPattern=expression_2)  # disabled
cull_2 = CullPattern(List=qfdm.PathSequence, CullPattern=expression)  # disabled
travels = Data(cull_2)  # disabled
sequenced_infill = Data(cull)  # disabled

# ----
# Scripts
panel_4 = Panel("sort_curves_component.py")
entwine_2 = Entwine(
    Branch00=panel_4,
    Branch01="sort_points_component.py",
    Branch02="redistribute_lookups_component.py",
    Branch03="divide_curves_component.py",
    Branch04="build_turn_waypoints_component.py",
    FlattenInputs=True)  # -> flatten(Result)

# ---- group: script directory
S = Script(modules=entwine_2)  # -> script_dirs; inputs modules: list
# ---------- S: Python ----------
"""
Path Resolver Component for GeomSeq
GH entry point: locates src/ module folders relative to the saved .gh file and adds them to sys.path, so other components can import geomseq_core/rhino_utils regardless of machine.
"""

import os
import sys


def _find_src_dir(start_dir):
    """Walk up from start_dir looking for a directory containing geomseq/."""
    current = os.path.abspath(start_dir)
    while True:
        if os.path.isdir(os.path.join(current, "geomseq")):
            return current
        parent = os.path.dirname(current)
        if parent == current:  # hit filesystem root, not found
            return None
        current = parent


def _find_module_path(search_root, module):
    """Search under search_root for a file or folder named exactly `module`, at any depth."""
    for root, dirs, files in os.walk(search_root):
        if module in dirs or module in files:
            return os.path.join(root, module)
    return None


gh_doc = ghenv.Component.OnPingDocument()  # type: ignore
script_dirs = []

if not gh_doc.FilePath:
    print("[geomseq] can't resolve project src/ -- .gh document hasn't been saved yet")
else:
    src_dir = _find_src_dir(os.path.dirname(gh_doc.FilePath))
    if src_dir is None:
        print("[geomseq] can't find a 'geomseq' folder walking up from the .gh document's location")
    else:
        search_root = os.path.join(src_dir, "geomseq", "src")
        for module in modules:  # type: ignore
            found = _find_module_path(search_root, module)
            if found is None:
                print("[geomseq] module not found under geomseq/src/: %s" % module)
            else:
                script_dirs.append(os.path.normpath(found))

for module_dir in script_dirs:
    parent_dir = os.path.dirname(module_dir)
    if parent_dir not in sys.path:
        sys.path.insert(0, parent_dir)
# ---------- end S ----------

# ----
item = ListItem(List=S, Index=0, Wrap=True)  # -> Item, Item1, Item2, Item3, Item4

panel_5 = Panel(item.Item2)
panel_6 = Panel(item.Item1)
panel_7 = Panel(item.Item4)
panel_8 = Panel(item.Item)
panel_9 = Panel(item.Item3)
ordercurves = MyPythonEditer(script=panel_8, curves_tree=crv_2, if_flip=Toggle(True))  # -> out, sorted_curves_tree, full_path_tree, travel_lines_tree, reversed_tree; inputs curves_tree: tree of Curve, if_flip: Boolean
#   port script: Script to execute
# ---------- ordercurves: Python ----------
__author__ = "Yen-Fen Chan"
__version__ = "0.1.0" # Updated to R-Tree version
__date__ = '2026.03.05'

import Rhino.Geometry as rg

def sort_curves_by_rtree_optimized(curves, start_point =rg.Point3d(0,0,0)):
    """
    使用 R-Tree 優化的貪婪路徑排序演算法。
    起始點設定為離 (0,0,0) 最近的曲線端點。
    """
    if not curves:
        return [], []
    
    # 1. 建立 R-Tree 與點位快取 (避免迴圈內重複存取 Rhino Object 屬性)
    id_to_point = {}
    rtree = rg.RTree()
    
    for i, c in enumerate(curves):
        start = c.PointAtStart
        end = c.PointAtEnd
        
        # 偶數 ID 代表 Start, 奇數 ID 代表 End
        s_id, e_id = i * 2, i * 2 + 1
        
        rtree.Insert(start, s_id)
        rtree.Insert(end, e_id)
        
        id_to_point[s_id] = start
        id_to_point[e_id] = end

    # 2. 尋找起始曲線：離 (0,0,0) 最近的端點
    first_idx = -1
    min_dist_to_sp = float("inf")
    first_is_rev = False

    for i, c in enumerate(curves):
        d_s = start_point.DistanceTo(c.PointAtStart)
        d_e = start_point.DistanceTo(c.PointAtEnd)
        
        if d_s < min_dist_to_sp:
            min_dist_to_sp = d_s
            first_idx = i
            first_is_rev = False
        if d_e < min_dist_to_sp:
            min_dist_to_sp = d_e
            first_idx = i
            first_is_rev = True

    # 初始化排序容器
    ordered_indices = [first_idx]
    reversals = [first_is_rev]
    used_indices = {first_idx}
    
    # 決定目前的最後一點位置
    last_pt = curves[first_idx].PointAtStart if first_is_rev else curves[first_idx].PointAtEnd

    # 3. 核心 R-Tree 搜尋迴圈
    while len(ordered_indices) < len(curves):
        # 使用 list 存儲最佳結果以供 callback 修改
        # [best_idx, best_dist, need_reverse]
        best_match = [-1, float("inf"), False]

        def search_callback(sender, e):
            idx = e.Id // 2
            if idx in used_indices: 
                return
            
            this_pt = id_to_point[e.Id]
            dist = last_pt.DistanceTo(this_pt)
            
            if dist < best_match[1]:
                best_match[1] = dist
                best_match[0] = idx
                best_match[2] = (e.Id % 2 == 1) # 如果撞到對方的 End，則該線需反轉

        # 執行 R-Tree 搜尋 (使用足夠大的球體範圍)
        rtree.Search(rg.Sphere(last_pt, 1000000), search_callback)

        next_idx = best_match[0]
        if next_idx == -1: 
            break # 防止異常中斷
        
        used_indices.add(next_idx)
        ordered_indices.append(next_idx)
        
        need_rev = best_match[2]
        reversals.append(need_rev)
        
        # 更新最後一點
        next_curve = curves[next_idx]
        last_pt = next_curve.PointAtStart if need_rev else next_curve.PointAtEnd

    # 4. 根據排序結果重建幾何物件
    ordered_curves = []
    for idx, rev in zip(ordered_indices, reversals):
        new_c = curves[idx].Duplicate()
        if rev: 
            new_c.Reverse()
        ordered_curves.append(new_c)

    return ordered_curves, ordered_indices

# --- 執行排序 ---
sorted_paths, ori_indices = sort_curves_by_rtree_optimized(unsorted_paths, start_point=rg.Point3d(31.9,80,0))
# ---------- end ordercurves ----------
ordercurves_2 = MyPythonEditer(script=panel_6, points_tree=pt)  # -> out, out_points_tree; inputs points_tree: tree of Point3d; same code as ordercurves
crv_4 = Curve(ordercurves.travel_lines_tree)
pline_2 = PolyLine(Vertices=flatten(ordercurves_2.out_points_tree), Closed=False)
crv_5 = Curve(ordercurves.sorted_curves_tree)
dividecurves = MyPythonEditer(script=panel_9, curves=crv_5, segment_lengths=Slider(0.7, range=0.1..5))  # -> out, pts_tree, lookups_tree, corner_indices_tree; inputs curves: list of Curve, segment_lengths: list of Double; same code as ordercurves
redist = RedistributeLookups(
    Lookups=dividecurves.lookups_tree,
    Low=number_slider_3,
    High=number_slider_4,
    Mode=toggle,
    Flat=number_slider_5,
    Corners=dividecurves.corner_indices_tree)
redistribute_lookups = MyPythonEditer(
    script=panel_5,
    lookups_tree=dividecurves.lookups_tree,
    corner_indices_tree=dividecurves.corner_indices_tree,
    low=number_slider_3,
    high=number_slider_4,
    mode=toggle,
    flat_pct=number_slider_5)  # -> out, out_lookups_tree; inputs lookups_tree: tree of Double, corner_indices_tree: tree of Int32, low: Double, high: Double, mode: Int32, flat_pct: Int32; same code as ordercurves
nameme_7 = MyPythonEditer(curves=ordercurves.sorted_curves_tree, lookups_tree=simplify(redist))  # -> out, out_points_tree; inputs curves: list of Curve, lookups_tree: tree of Double
# ---------- nameme_7: Python ----------
import Rhino.Geometry as rg
import ghpythonlib.treehelpers as th

lookups = th.tree_to_list(lookups_tree)

sampled_points = []
for params, curve in zip(lookups, curves):
    curve_points = []
    for length in params:
        success, t = curve.LengthParameter(length)
        if success:
            curve_points.append(curve.PointAt(t))
    sampled_points.append(curve_points)

out_points_tree = th.list_to_tree(sampled_points)
# ---------- end nameme_7 ----------
pt_4 = Point(dividecurves.pts_tree)
nameme_8 = MyPythonEditer(curves=ordercurves.sorted_curves_tree, lookups_tree=redistribute_lookups.out_lookups_tree)  # -> out, out_points_tree; inputs curves: list of Curve, lookups_tree: tree of Double; same code as nameme_7
flip = FlipMatrix(Data=crv_5)
flip_2 = FlipMatrix(Data=crv_4)
len_5 = Length(Curve=pline_2)
cx = CurveSelf(Curve=pline_2)  # -> Points, Params
lng = ListLength(List=nameme_8.out_points_tree)  # -> expr("X-2", Length)
merge = Merge(Data1=flip, Data2=flip_2)  # -> flatten(Result)
viewer = ParamViewer(cx.Points)
panel_10 = Panel(len_5)
split_2 = SplitList(List=nameme_8.out_points_tree, Index=lng)  # -> ListA, ListB
split_3 = SplitList(List=nameme_8.out_points_tree, Index="2")  # -> ListA, ListB
item_2 = ListItem(List=merge, Index=0, Wrap=True)  # -> Item, Item1
build_turn_waypoints = MyPythonEditer(
    script=panel_7,
    points_tree=nameme_8.out_points_tree,
    theta_max_deg=Slider(30, range=1..90),
    step_len=Slider(3, range=1..30),
    extend_len=Slider(1, range=1..30))  # -> out, waypoints_tree; inputs points_tree: tree of Point3d, theta_max_deg: Double, step_len: Double, extend_len: Double; same code as ordercurves
branch = TreeBranch(Tree=simplify(split_3.ListA), Path="1", MaintainPaths=True)
branch_2 = TreeBranch(Tree=simplify(split_2.ListB), Path="0", MaintainPaths=True)
panel_11 = Panel(branch_2)
panel_12 = Panel(branch)
panel_13 = Panel(build_turn_waypoints.waypoints_tree)
pline_3 = PolyLine(Vertices=build_turn_waypoints.waypoints_tree, Closed=False)
points = PointList(Points=build_turn_waypoints.waypoints_tree)
