# Grasshopper definition sort_curves.gh (Grasshopper 1.0.8)
# plug-ins: HorseshoeGH, GeomSeq

panel = Panel("geomseq — sort_curves example")

# ---- group: Do not edit
S = Script(modules="sort_curves_component.py")  # -> script_dirs; inputs modules: list
# ---------- S: Python ----------
import os
import sys


def _find_src_dir(start_dir):
    """Walk up from start_dir looking for a directory containing geomseq/."""
    current = os.path.abspath(start_dir)
    while True:
        if os.path.isdir(os.path.join(current, "geomseq")):
            return current
        parent = os.path.dirname(current)
        if parent == current:  # hit filesystem root, not found
            return None
        current = parent


def _find_module_path(search_root, module):
    """Search under search_root for a file or folder named exactly `module`, at any depth."""
    for root, dirs, files in os.walk(search_root):
        if module in dirs or module in files:
            return os.path.join(root, module)
    return None


gh_doc = ghenv.Component.OnPingDocument()  # type: ignore
script_dirs = []

if not gh_doc.FilePath:
    print("[geomseq] can't resolve project src/ -- .gh document hasn't been saved yet")
else:
    src_dir = _find_src_dir(os.path.dirname(gh_doc.FilePath))
    if src_dir is None:
        print("[geomseq] can't find a 'geomseq' folder walking up from the .gh document's location")
    else:
        # Search inside geomseq/src/ only -- NOT src_dir itself. src_dir is the
        # .gh file's parent directory and may contain unrelated sibling
        # folders (e.g. a leftover D2M checkout from before the geomseq_core
        # rename) that happen to contain a file/folder with the same name as
        # a searched module; os.walk over the wider src_dir can match that
        # stale sibling before it ever reaches the real one under geomseq/src/.
        search_root = os.path.join(src_dir, "geomseq", "src")
        for module in modules:  # type: ignore
            found = _find_module_path(search_root, module)
            if found is None:
                print("[geomseq] module not found under geomseq/src/: %s" % module)
            else:
                script_dirs.append(os.path.normpath(found))

# sys.path needs each module's *parent* folder (src/), not the module folder
# itself, since downstream components do `import geomseq_core` /
# `import rhino_utils`, not `import <folder contents directly>`.
for module_dir in script_dirs:
    parent_dir = os.path.dirname(module_dir)
    if parent_dir not in sys.path:
        sys.path.insert(0, parent_dir)
# ---------- end S ----------

# ----
if_flip = BooleanToggle(True)
list = ValueList({"List (Single Branch)": 0, "Tree (Multiple Branches)": 1}, selected="List (Single Branch)")
list_2 = ValueList({"1k random curves": 0, "5k random curves": 1, "10k random curves": 2, "50k random curves": 3}, selected="1k random curves")
crv = Curve([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])
crv_2 = Curve([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])
crv_3 = Curve([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])
crv_4 = Curve([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])
filter = StreamFilter(Gate=list_2, Stream0=crv, Stream1=crv_2, Stream2=crv_3, Stream3=crv_4)
lng = ListLength(List=filter)  # -> expr("x/2", Length)
partition = PartitionList(List=filter, Size=lng)
filter_2 = StreamFilter(Gate=list, Stream0=filter, Stream1=partition)

# ---- group: Release!
dam = DataDam(DataA=filter_2, BufferDelay=10000000, BufferMode=0)

# ----
xy = XYPlane(Origin=Point(0, 0, 0))  # disabled
viewer = ParamViewer(dam)
sort_curves = MyPythonEditer(script=S, curves_tree=dam, start_point=xy, if_flip=if_flip)  # -> out, sorted_curves_tree, travel_lines_tree, full_path_tree, full_types_tree, reversed_tree; inputs curves_tree: tree of Curve, start_point: Point3d, if_flip: Boolean
#   port script: Script to execute
# ---------- sort_curves: Python ----------
__author__ = "Yen-Fen Chan"
__version__ = "0.1.0" # Updated to R-Tree version
__date__ = '2026.03.05'

import Rhino.Geometry as rg

def sort_curves_by_rtree_optimized(curves, start_point =rg.Point3d(0,0,0)):
    """
    使用 R-Tree 優化的貪婪路徑排序演算法。
    起始點設定為離 (0,0,0) 最近的曲線端點。
    """
    if not curves:
        return [], []
    
    # 1. 建立 R-Tree 與點位快取 (避免迴圈內重複存取 Rhino Object 屬性)
    id_to_point = {}
    rtree = rg.RTree()
    
    for i, c in enumerate(curves):
        start = c.PointAtStart
        end = c.PointAtEnd
        
        # 偶數 ID 代表 Start, 奇數 ID 代表 End
        s_id, e_id = i * 2, i * 2 + 1
        
        rtree.Insert(start, s_id)
        rtree.Insert(end, e_id)
        
        id_to_point[s_id] = start
        id_to_point[e_id] = end

    # 2. 尋找起始曲線：離 (0,0,0) 最近的端點
    first_idx = -1
    min_dist_to_sp = float("inf")
    first_is_rev = False

    for i, c in enumerate(curves):
        d_s = start_point.DistanceTo(c.PointAtStart)
        d_e = start_point.DistanceTo(c.PointAtEnd)
        
        if d_s < min_dist_to_sp:
            min_dist_to_sp = d_s
            first_idx = i
            first_is_rev = False
        if d_e < min_dist_to_sp:
            min_dist_to_sp = d_e
            first_idx = i
            first_is_rev = True

    # 初始化排序容器
    ordered_indices = [first_idx]
    reversals = [first_is_rev]
    used_indices = {first_idx}
    
    # 決定目前的最後一點位置
    last_pt = curves[first_idx].PointAtStart if first_is_rev else curves[first_idx].PointAtEnd

    # 3. 核心 R-Tree 搜尋迴圈
    while len(ordered_indices) < len(curves):
        # 使用 list 存儲最佳結果以供 callback 修改
        # [best_idx, best_dist, need_reverse]
        best_match = [-1, float("inf"), False]

        def search_callback(sender, e):
            idx = e.Id // 2
            if idx in used_indices: 
                return
            
            this_pt = id_to_point[e.Id]
            dist = last_pt.DistanceTo(this_pt)
            
            if dist < best_match[1]:
                best_match[1] = dist
                best_match[0] = idx
                best_match[2] = (e.Id % 2 == 1) # 如果撞到對方的 End，則該線需反轉

        # 執行 R-Tree 搜尋 (使用足夠大的球體範圍)
        rtree.Search(rg.Sphere(last_pt, 1000000), search_callback)

        next_idx = best_match[0]
        if next_idx == -1: 
            break # 防止異常中斷
        
        used_indices.add(next_idx)
        ordered_indices.append(next_idx)
        
        need_rev = best_match[2]
        reversals.append(need_rev)
        
        # 更新最後一點
        next_curve = curves[next_idx]
        last_pt = next_curve.PointAtStart if need_rev else next_curve.PointAtEnd

    # 4. 根據排序結果重建幾何物件
    ordered_curves = []
    for idx, rev in zip(ordered_indices, reversals):
        new_c = curves[idx].Duplicate()
        if rev: 
            new_c.Reverse()
        ordered_curves.append(new_c)

    return ordered_curves, ordered_indices

# --- 執行排序 ---
sorted_paths, ori_indices = sort_curves_by_rtree_optimized(unsorted_paths, start_point=rg.Point3d(31.9,80,0))
# ---------- end sort_curves ----------
ordercurves = MyPythonEditer(unsorted_paths=dam)  # -> out, sorted_paths, ori_dices; inputs unsorted_paths: list of Curve; disabled
# ---------- ordercurves: Python ----------
__author__ = "Yen-Fen Chan"
__version__ = "0.0.1"
__date__ = '2024.00.00'
__updated__ = '2024.00.00'

import Rhino.Geometry as rg
import numpy as np
from scipy.spatial import KDTree

def order_curves_nn(curves):
    """
    Greedy nearest‐neighbor sort of curves using a static KDTree over all endpoints.
    
    :param curves: list of rg.Curve
    :return: ordered list of rg.Curve
    """
    crvs = list(curves)
    n = len(crvs)
    if n == 0:
        return []

    # 1) Pick a “leftmost” starting curve (by X, then Y)
    def leftmost_point(c):
        a, b = c.PointAtStart, c.PointAtEnd
        return a if (a.X, a.Y) < (b.X, b.Y) else b

    start_idx = min(range(n), key=lambda i: leftmost_point(crvs[i]).X)
    start = crvs[start_idx].DuplicateCurve()
    if start.PointAtStart.X > start.PointAtEnd.X:
        start.Reverse()

    ordered = [start]
    used = {start_idx}

    # 2) Build one flat array of all endpoints and a map back to (curve_idx, is_end)
    coords = []
    id_map = []  # each entry is (curve_index, is_end_flag)
    for idx, c in enumerate(crvs):
        ps, pe = c.PointAtStart, c.PointAtEnd
        coords.append((ps.X, ps.Y))
        id_map.append((idx, False))
        coords.append((pe.X, pe.Y))
        id_map.append((idx, True))


    coords = np.array(coords)  
    tree = KDTree(coords)  # one‐time build
    # 3) For each remaining curve, query ALL endpoints in ascending distance
    total_pts = coords.shape[0]
    while len(used) < n:
        last_pt = ordered[-1].PointAtEnd
        # get indices of ALL points, sorted by distance
        dists, idxs = tree.query([last_pt.X, last_pt.Y], k=total_pts)
        if isinstance(idxs, int):
            idxs = [idxs]

        # scan neighbors until we find one whose curve isn't used
        for i in idxs:
            cid, is_end = id_map[int(i)]
            if cid in used:
                continue
            # found the next curve
            nxt = crvs[cid].DuplicateCurve()
            if is_end:
                nxt.Reverse()
            ordered.append(nxt)
            used.add(cid)
            break

    return ordered



sorted_paths = order_curves_nn(unsorted_paths)
# ---------- end ordercurves ----------
qfdm = HS_QuickFDM(Plane=PlaneXY(0, 0, 0), Infill=dam, ProximityTolerance=0.01, CombineTolerance=0.01, StartPoint=xy)  # -> PathSequence, Indices, SegmentType, Flipped; disabled
xy_2 = XYPlane(Origin=Point(0, 0, 0))
sortcrv = SortCurves(Curves=dam, Start=xy_2, Travel=False, Flip=if_flip)  # -> Curves, Indices, Reversed, Distance, Travel
connect = ConnectCurves(Curves=sortcrv.Curves, Continuity=0, Close=True, Bulge=1)
